# Grasshopper definition gameoflife.gh (Grasshopper 1.0.7)
# plug-ins: ScriptParasite

number_slider = Slider(30, range=0..100)
number_slider_2 = Slider(30, range=0..100)
sqgrid = Square(Plane=PlaneXY(0, 0, 0), Size=1, ExtentX=number_slider_2, ExtentY=number_slider)  # -> Cells, Points
crv = Curve(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)
pt = Point(sqgrid.Points)
incurve = PointInCurve(Point=pt, Curve=crv)  # -> Relationship, Point
addition = Addition(A=number_slider_2, B="1")
addition_2 = Addition(A=number_slider, B="1")
equals = Equality(FirstNumber=incurve.Relationship, SecondNumber="2")  # -> Equality, Inequality
panel = Panel(equals.Equality)
flatten = FlattenTree(Tree=equals.Equality, Path="{0}")
panel_2 = Panel("""2
3""")
flatten_2 = FlattenTree(Tree=pt, Path="{0}")
path = FilePath("D:\GitHub\trkRhinoGHcs\scriptparasite\GameOfLife\")

gameoflife = CSharpScript(
    cells=flatten,
    rows=addition_2,
    columns=addition,
    birthRule="3",
    survivalRule=panel_2,
    run=Toggle(True),
    reset=Toggle(False))  # -> out, previous, newIteration, A; inputs cells: list of Boolean, rows: Int32, columns: Int32, birthRule: list of Int32, survivalRule: list of Int32, run: Boolean, reset: Boolean
# ---------- gameoflife: C# ----------
            //Sanity
            if (run == false)
            {
                return;
            }

            if (cells.Count != rows * columns)
            {
                Component.AddRuntimeMessage(GH_RuntimeMessageLevel.Error, "something weird with dimension of grid");
                return;
            }



            //turn list into 2d array
            bool[,] cellArray = new bool[columns, rows];
            int it = 0;

            for (int j = 0; j < columns; j++)
            {
                for (int i = 0; i < rows; i++)
                {
                    cellArray[j, i] = cells[it];
                    it++;
                }
            }

            //new array of alive/dead cells for next iteration

            bool[,] newCells = new bool[columns, rows];
            int[,] nCount = new int[columns, rows];
            for (int j = 0; j < columns; j++)
            {
                for (int i = 0; i < rows; i++)
                {

                    //compute alive neighbors
                    int aliveNeighbors = 0;
                    int ni, nj;

                    // topleft
                    ni = i + 1;
                    nj = j - 1;
                    if (ni > rows - 1) ni = 0;
                    else if (ni < 0) ni = rows - 1;
                    if (nj > columns - 1) nj = 0;
                    else if (nj < 0) nj = columns - 1;
                    if (cellArray[nj, ni] == true) aliveNeighbors++;

                    // top
                    ni = i + 1;
                    nj = j;
                    if (ni > rows - 1) ni = 0;
                    else if (ni < 0) ni = rows - 1;
                    if (nj > columns - 1) nj = 0;
                    else if (nj < 0) nj = columns - 1;
                    if (cellArray[nj, ni] == true) aliveNeighbors++;

                    // topright
                    ni = i + 1;
                    nj = j + 1;
                    if (ni > rows - 1) ni = 0;
                    else if (ni < 0) ni = rows - 1;
                    if (nj > columns - 1) nj = 0;
                    else if (nj < 0) nj = columns - 1;
                    if (cellArray[nj, ni] == true) aliveNeighbors++;

                    // left
                    ni = i;
                    nj = j - 1;
                    if (ni > rows - 1) ni = 0;
                    else if (ni < 0) ni = rows - 1;
                    if (nj > columns - 1) nj = 0;
                    else if (nj < 0) nj = columns - 1;
                    if (cellArray[nj, ni] == true) aliveNeighbors++;

                    // right
                    ni = i;
                    nj = j + 1;
                    if (ni > rows - 1) ni = 0;
                    else if (ni < 0) ni = rows - 1;
                    if (nj > columns - 1) nj = 0;
                    else if (nj < 0) nj = columns - 1;
                    if (cellArray[nj, ni] == true) aliveNeighbors++;

                    // bottomleft
                    ni = i - 1;
                    nj = j - 1;
                    if (ni > rows - 1) ni = 0;
                    else if (ni < 0) ni = rows - 1;
                    if (nj > columns - 1) nj = 0;
                    else if (nj < 0) nj = columns - 1;
                    if (cellArray[nj, ni] == true) aliveNeighbors++;

                    // bottom
                    ni = i - 1;
                    nj = j;
                    if (ni > rows - 1) ni = 0;
                    else if (ni < 0) ni = rows - 1;
                    if (nj > columns - 1) nj = 0;
                    else if (nj < 0) nj = columns - 1;
                    if (cellArray[nj, ni] == true) aliveNeighbors++;

                    // bottomright
                    ni = i - 1;
                    nj = j + 1;
                    if (ni > rows - 1) ni = 0;
                    else if (ni < 0) ni = rows - 1;
                    if (nj > columns - 1) nj = 0;
                    else if (nj < 0) nj = columns - 1;
                    if (cellArray[nj, ni] == true) aliveNeighbors++;

                    Print("alive neighbors: " + aliveNeighbors);
                    nCount[j, i] = aliveNeighbors;

                    //compute new state
                    bool prevState = cellArray[j, i];
                    bool newState = false;

                    //if cells were dead
                    if (prevState == false)
                    {
                        foreach (int b in birthRule)
                        {
                            if (b == aliveNeighbors)
                            {
                                newState = true;
                                break;
                            }
                        }
                    }

                    //if cell was alive
                    else
                    {
                        foreach (int s in survivalRule)
                        {
                            if (s == aliveNeighbors)
                            {
                                newState = true;
                                break;
                            }
                        }
                    }

                    //store new state in array
                    newCells[j, i] = newState;
                }
            }

            previous = cellArray;
            newIteration = newCells;
            A = nCount;
            //Print("end of script");
# ---------- end gameoflife ----------
scriptpar = ScriptParasite(Enable=Toggle(True), Folder=path)

cull = CullPattern(List=incurve.Point, CullPattern=equals.Equality)
panel_3 = Panel(gameoflife.A)
panel_4 = Panel(gameoflife.newIteration)
cull_2 = CullPattern(List=flatten_2, CullPattern=gameoflife.newIteration)
panel_5 = Panel(gameoflife.previous)
dots = DotDisplay(Point=cull, Colour=RGB(222, 38, 124), Size=0.2)
tag = TextTag3D(Location=flatten_2, Text=gameoflife.A, Size=Slider(0.5, range=0..1), Justification=7)
dots_2 = DotDisplay(Point=cull_2, Colour=RGB(38, 222, 173), Size=0.3)
panel_6 = Panel(gameoflife.out)
